# Grasshopper definition WF04_retaining-wall.gh (Grasshopper 1.0.8)

curve = Curve([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])
surface = Surface(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)
curve_2 = Curve([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])
loft = Loft(Curves=curve_2, Options={Adjust=False, Closed=False, LoftEnds=0, LoftSimp=0, LoftType=0, Rebuild=10, Refit=0.01})
patch = Patch(Curves=curve, Spans=20, Flexibility=1, Trim=True)
brep_join = BrepJoin(Breps=[loft, patch, surface])  # -> Breps, Closed
unit_z = UnitZ(Factor=1)
contour = Contour(Shape=brep_join.Breps, Point=Point(0, 0, 0), Direction=unit_z, Distance=Slider(1, range=0..1))
