# Grasshopper definition WF05_demo_session1.gh (Grasshopper 1.0.8)

curve = Curve([<curve referenced from the Rhino model> x2])
construct_domain = ConstructDomain(DomainStart=Slider(2, range=0..10), DomainEnd=Slider(9, range=0..10))

# ---- group: makes random poitns
number_slider = Slider(50, range=0..100)
rectangle = Rectangle(Plane=PlaneXY(0, 0, 0), XSize=number_slider, YSize=number_slider, Radius=0)  # -> Rectangle, Length
populate_2d = Populate2D(Region=rectangle.Rectangle, Count=Slider(1000, range=0..1000), Seed=1)

# ---- group: test the points
pull_point = PullPoint(Point=populate_2d, Geometry=curve, ClosestOnly=True)  # -> ClosestPoint, Distance, Index
larger_than = LargerThan(FirstNumber=pull_point.Distance, SecondNumber=Slider(3, range=0..10))  # -> LargerThan, OrEqualTo
dispatch = Dispatch(List=populate_2d, DispatchPattern=larger_than.LargerThan)  # -> ListA, ListB
point = Point(dispatch.ListA)
point_2 = Point(dispatch.ListB)

# ---- group: draw random lines
list_length = ListLength(List=point)
random = Random(Range=construct_domain, Number=list_length, Seed=2)
line_sdl = LineSDL(Start=point, Direction=Vector(0, 0, 1), Length=random)

# ----
line_sdl_2 = LineSDL(Start=point_2, Direction=Vector(0, 0, 1), Length=Slider(0.4, range=0..1))
panel = Panel("2 to 6")
