# Grasshopper definition WF05_demo_session2.gh (Grasshopper 1.0.8)

# ---- group: makes random poitns
number_slider = Slider(50, range=0..100)
rectangle = Rectangle(Plane=PlaneXY(0, 0, 0), XSize=number_slider, YSize=number_slider, Radius=0)  # -> Rectangle, Length
populate_2d = Populate2D(Region=rectangle.Rectangle, Count=Slider(1000, range=0..1000), Seed=1)

# ---- group: change only these / radius of the sprinklers
number_slider_2 = Slider(15, range=0..100)

# ---- group: mowing width
number_slider_3 = Slider(3, range=0..10)

# ---- group: start here / mowing paths
curve = Curve(<curve referenced from the Rhino model>)

# ---- group: start here / Sprinklers
point = Point([<point referenced from the Rhino model> x3])

# ---- group: change only these
construct_domain = ConstructDomain(DomainStart=Slider(10, range=0..10), DomainEnd=Slider(1, range=0..1))

# ---- group: test the points
pull_point = PullPoint(Point=populate_2d, Geometry=curve, ClosestOnly=True)  # -> ClosestPoint, Distance, Index
larger_than = LargerThan(FirstNumber=pull_point.Distance, SecondNumber=number_slider_3)  # -> LargerThan, OrEqualTo
dispatch = Dispatch(List=populate_2d, DispatchPattern=larger_than.LargerThan)  # -> ListA, ListB
point_2 = Point(dispatch.ListA)
point_3 = Point(dispatch.ListB)

# ----
pull_point_2 = PullPoint(Point=point_2, Geometry=point, ClosestOnly=True)  # -> ClosestPoint, Distance, Index

# ---- group: don't touch!
construct_domain_2 = ConstructDomain(DomainStart=Slider(0, range=0..100), DomainEnd=number_slider_2)
minimum = Minimum(A=pull_point_2.Distance, B=number_slider_2)
remap_numbers = RemapNumbers(Value=minimum, Source=construct_domain_2, Target=construct_domain)  # -> Mapped, Clipped

# ---- group: how to remap in python
# double click the python component to see the code in side
python_3_script = Python3Script(v=minimum, a=Slider(0, range=0..100), b=Slider(15, range=0..100), c=Slider(9, range=0..10), d=Slider(1, range=0..1))  # -> r
# ---------- python_3_script: Python ----------
"""Remap v from source domain [a, b] to target domain [c, d].
    Inputs:
        v: value(s) to remap
        a: source start
        b: source end
        c: target start
        d: target end
    Output:
        r: remapped value(s)"""

def remap(v, a, b, c, d):
    if b == a:
        return c  # degenerate source domain: collapse to target start
    return c + (v - a) * (d - c) / (b - a)

if isinstance(v, (list, tuple)):
    r = [remap(x, a, b, c, d) for x in v]
else:
    r = remap(v, a, b, c, d)
# ---------- end python_3_script ----------

# ---- group: mowed path
line_sdl = LineSDL(Start=point_3, Direction=Vector(0, 0, 1), Length=Slider(0.4, range=0..1))

# ----
line_sdl_2 = LineSDL(Start=point_2, Direction=Vector(0, 0, 1), Length=remap_numbers.Mapped)

# ---- group: draw random lines no water
construct_domain_3 = ConstructDomain(DomainStart=Slider(2, range=0..10), DomainEnd=Slider(9, range=0..10))
list_length = ListLength()
random = Random(Range=construct_domain_3, Number=list_length, Seed=2)
line_sdl_3 = LineSDL(Direction=Vector(0, 0, 1), Length=random)
