# Grasshopper definition WF05_mow.gh (Grasshopper 1.0.8)

number_slider = Slider(50, range=0..100)
number_slider_2 = Slider(1000, range=0..1000)
rectangle = Rectangle(Plane=PlaneXY(0, 0, 0), XSize=number_slider, YSize=number_slider, Radius=0)  # -> Rectangle, Length
pop2d = Populate2D(Region=rectangle.Rectangle, Count=number_slider_2, Seed=1)
crv = Curve(<curve referenced from the Rhino model>)
pull = PullPoint(Point=pop2d, Geometry=crv, ClosestOnly=True)  # -> ClosestPoint, Distance, Index
larger = LargerThan(FirstNumber=pull.Distance, SecondNumber=Slider(2, range=0..10))  # -> LargerThan, OrEqualTo
random = Random(Range="2 to 6.0", Number=number_slider_2, Seed=2)
dispatch = Dispatch(List=pop2d, DispatchPattern=larger.LargerThan)  # -> ListA, ListB
Z = UnitZ(Factor=1)
Z_2 = UnitZ(Factor=1)
line = LineSDL(Start=dispatch.ListB, Direction=Z_2, Length=Slider(0.7, range=0..1))
line_2 = LineSDL(Start=dispatch.ListA, Direction=Z, Length=random)
