# Grasshopper definition WF05_mow_water.gh (Grasshopper 1.0.8)

number_slider = Slider(50, range=0..100)
number_slider_2 = Slider(1000, range=0..1000)
rectangle = Rectangle(Plane=PlaneXY(0, 0, 0), XSize=number_slider, YSize=number_slider, Radius=0)  # -> Rectangle, Length

# ---- group: setup your curve
crv = Curve(<curve referenced from the Rhino model>)

# ---- group: Wet area attractors
pt = Point([<point referenced from the Rhino model> x3])

# ----
pop2d = Populate2D(Region=rectangle.Rectangle, Count=number_slider_2, Seed=1)
pull = PullPoint(Point=pop2d, Geometry=crv, ClosestOnly=True)  # -> ClosestPoint, Distance, Index

# ---- group: From Step one before introducing water
random = Random(Range="2 to 6.0", Number=number_slider_2, Seed=2)

# ----
number_slider_3 = Slider(15, range=0..100)
larger = LargerThan(FirstNumber=pull.Distance, SecondNumber=Slider(2, range=0..10))  # -> LargerThan, OrEqualTo
dispatch = Dispatch(List=pop2d, DispatchPattern=larger.LargerThan)  # -> ListA, ListB
pull_2 = PullPoint(Point=dispatch.ListA, Geometry=pt, ClosestOnly=True)  # -> ClosestPoint, Distance, Index
min = Minimum(A=pull_2.Distance, B=number_slider_3)
dom = ConstructDomain(DomainStart="0", DomainEnd=number_slider_3)
dom_2 = ConstructDomain(DomainStart=Slider(9, range=0..10), DomainEnd=Slider(1, range=0..1))
Z = UnitZ(Factor=1)
remap = RemapNumbers(Value=min, Source=dom, Target=dom_2)  # -> Mapped, Clipped
line = LineSDL(Start=dispatch.ListB, Direction=Z, Length=Slider(0.5, range=0..1))
Z_2 = UnitZ(Factor=1)
line_2 = LineSDL(Start=dispatch.ListA, Direction=Z_2, Length=remap.Mapped)
