# Grasshopper definition WF05_mow_water_landform.gh (Grasshopper 1.0.8)

# ---- group: generate a field of points
number_slider = Slider(50, range=0..100)
rectangle = Rectangle(Plane=PlaneXY(0, 0, 0), XSize=number_slider, YSize=number_slider, Radius=0)  # -> Rectangle, Length
populate_2d = Populate2D(Region=rectangle.Rectangle, Count=Slider(1000, range=0..1000), Seed=1)

# ----
surface = Surface(<surface referenced from the Rhino model>)
curve = Curve([<curve referenced from the Rhino model> x2])

# ---- group: wet area
point = Point([<point referenced from the Rhino model> x3])

# ---- group: Project points to surface
pull_point = PullPoint(Point=populate_2d, Geometry=surface, ClosestOnly=True)  # -> ClosestPoint, Distance, Index
pull_point_2 = PullPoint(Point=point, Geometry=surface, ClosestOnly=True)  # -> ClosestPoint, Distance, Index
project_curve = ProjectCurve(Curve=curve, Brep=surface, Direction=Vector(0, 0, 1))  # -> flatten(Curve)

# ----
contour = Contour(Shape=surface, Point=Point(0, 0, 0), Direction=Vector(0, 0, 1), Distance=Slider(1, range=0..1))

# ---- group: dispatch points based on rules
pull_point_3 = PullPoint(Point=pull_point.ClosestPoint, Geometry=project_curve, ClosestOnly=True)  # -> ClosestPoint, Distance, Index
larger_than = LargerThan(FirstNumber=pull_point_3.Distance, SecondNumber=Slider(3, range=0..10))  # -> LargerThan, OrEqualTo
dispatch = Dispatch(List=pull_point.ClosestPoint, DispatchPattern=larger_than.LargerThan)  # -> ListA, ListB

# ----
number_slider_2 = Slider(18, range=0..100)
point_2 = Point(dispatch.ListA)
pull_point_4 = PullPoint(Point=point_2, Geometry=pull_point_2.ClosestPoint, ClosestOnly=True)  # -> ClosestPoint, Distance, Index
construct_domain = ConstructDomain(DomainStart="0", DomainEnd=number_slider_2)
construct_domain_2 = ConstructDomain(DomainStart=Slider(5, range=0.2..5), DomainEnd=Slider(0.2, range=0.2..5))
minimum = Minimum(A=pull_point_4.Distance, B=number_slider_2)
line_sdl = LineSDL(Start=dispatch.ListB, Direction=Vector(0, 0, 1), Length=Slider(0.2, range=0..1))
remap_numbers = RemapNumbers(Value=minimum, Source=construct_domain, Target=construct_domain_2)  # -> Mapped, Clipped
line_sdl_2 = LineSDL(Start=point_2, Direction=Vector(0, 0, 1), Length=remap_numbers.Mapped)
